# Grasshopper definition layout_and_terrain.gh (Grasshopper 1.0.8)
# plug-ins: Human, FloorPlanGenerator

# ---- group: Terrain Surface
rectangle = Rectangle(Plane=PlaneXY(0, 0, 0), XSize=Slider(25, range=0..100), YSize=Slider(30, range=0..100), Radius=0)  # -> Rectangle, Length
boundary_surfaces = BoundarySurfaces(Edges=rectangle.Rectangle)
divide_surface = DivideSurface(Surface=boundary_surfaces, UCount=Slider(25, range=0..25), VCount=Slider(30, range=0..30))  # -> Points, Normals, Parameters
evaluate_surface = EvaluateSurface(Surface=boundary_surfaces, Point=divide_surface.Points)  # -> flatten(Point), Normal, UDirection, VDirection, Frame

# ---- group: Street Axis
construct_point = ConstructPoint(XCoordinate=Slider(-20, range=-100..100), YCoordinate=Slider(37.5, range=0..100), ZCoordinate=0)
construct_point_2 = ConstructPoint(XCoordinate=Slider(45, range=0..100), YCoordinate=Slider(37.5, range=0..100), ZCoordinate=0)
line = Line(StartPoint=construct_point_2, EndPoint=construct_point)

# ---- group: Closest Building West Facade
construct_point_3 = ConstructPoint(XCoordinate=Slider(-3, range=-100..100), YCoordinate=Slider(30, range=0..100), ZCoordinate=0)
construct_point_4 = ConstructPoint(XCoordinate=Slider(-3, range=-100..100), YCoordinate=Slider(0, range=0..100), ZCoordinate=0)
line_2 = Line(StartPoint=construct_point_4, EndPoint=construct_point_3)

# ---- group: Closest Building East Facade
construct_point_5 = ConstructPoint(XCoordinate=Slider(25, range=-100..100), YCoordinate=Slider(30, range=0..100), ZCoordinate=0)
construct_point_6 = ConstructPoint(XCoordinate=Slider(25, range=-100..100), YCoordinate=Slider(0, range=0..100), ZCoordinate=0)
line_3 = Line(StartPoint=construct_point_6, EndPoint=construct_point_5)

# ---- group: USER INPUT
panel = Panel("I am looking for a floor plan for an apartment located in Guimarães, Portugal, with a total area not exceeding 100 m². The apartment should include the following rooms: foyer, kitchen, laundry, living room (exactly 20 m²),  toilet, dining room, corridor, office, two bedrooms, and two bathrooms. The toilet should be directly connected to the foyer for easy access by visitors. From the foyer, guests should have direct access to the living room, which must also connect to the corridor, kitchen, and dining room. The corridor is connected to the office, both bedroom and living room. Laundry is only connected to the kitchen. The two bathrooms must be ensuite, each connected to one of the bedrooms. It is important that the bedrooms and the office are located in quiet areas to ensure comfort and concentration. The living room must receive direct sunlight between 9:00 AM and 12:00 PM. Additionally, only the foyer, guest toilet, corridor, and both ensuite bathrooms should be windowless; all other rooms must have at least one window to ensure proper natural lighting and ventilation.")

# ---- group: Max and Min in X and Y
# Exploding the surface
# to get the limits
bounding_box = BoundingBox(Content=rectangle.Rectangle, Plane=PlaneXY(0, 0, 0))  # -> Box, Box_2
deconstruct_box = DeconstructBox(Box=bounding_box.Box)  # -> Plane, X, Y, Z
unit_x = UnitX(Factor=deconstruct_box.X)
unit_y = UnitY(Factor=deconstruct_box.Y)
deconstruct = Deconstruct(Point=unit_x)  # -> XComponent, YComponent, ZComponent
deconstruct_2 = Deconstruct(Point=unit_y)  # -> XComponent, YComponent, ZComponent
maximum = Maximum(A=deconstruct.XComponent, B=deconstruct.YComponent)  # -> flatten(Result)
minimum = Minimum(A=deconstruct.XComponent, B=deconstruct.YComponent)  # -> flatten(Result)
maximum_2 = Maximum(A=deconstruct_2.XComponent, B=deconstruct_2.YComponent)  # -> flatten(Result)
minimum_2 = Minimum(A=deconstruct_2.XComponent, B=deconstruct_2.YComponent)  # -> flatten(Result)
panel_2 = Panel(maximum)
panel_3 = Panel(minimum)
panel_4 = Panel(maximum_2)
panel_5 = Panel(minimum_2)

# ---- group: Convert the user text into a machine-readable format
py3 = Python3Script(input_text=panel, run=Toggle(True))  # -> out, out_2
# ---------- py3: Python ----------
import requests

url = 'http://localhost:5000/get_parameters'
payload = {'input': input_text}

out = None
if run:
    try:
        response = requests.post(url, json=payload)
        response.raise_for_status()
        
        # Debug prints
        print("Raw response:", response.text)
        data = response.json()
        print("Parsed JSON:", data)
        print("Response data:", data['response'])
        
        out = str(data['response'])
    except requests.exceptions.RequestException as e:
        out = f"Failed to connect: {str(e)}"

a = out
# ---------- end py3 ----------
panel_6 = Panel(py3.out_2)

# ----
# Building
geometry = Geometry([<brep referenced from the Rhino model> x3])

# ---- group: Solar analysis
panel_7 = Panel("https://climate.onebuilding.org/WMO_Region_6_Europe/PRT_Portugal/NO_Norte/PRT_NO_Porto-Carneiro.AP.085450_TMYx.2004-2018.zip")
downloadepw = LBDownloadWeather(weather_URL=panel_7)  # -> epw_file, stat_file, ddy_file; plug-in component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
importloc = LBImportLocation(epw_file=downloadepw.epw_file)  # -> location; plug-in component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
importepw = LBImportEPW(epw_file=downloadepw.epw_file)  # -> location, dry_bulb_temperature, dew_point_temperature, relative_humidity, wind_speed, wind_direction, direct_normal_rad, diffuse_horizontal_rad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; plug-in component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
# Surrounding area
geometry_2 = Geometry([<brep referenced from the Rhino model> x48, <extrusion referenced from the Rhino model>, <brep referenced from the Rhino model> x3])
panel_8 = Panel(importloc)
custom_preview = CustomPreview(Geometry=geometry_2, Material=ColourSwatch(SwatchColor=RGB(255, 255, 255)))
# SEPTEMBER
panel_9 = Panel("21")
# MARCH
panel_10 = Panel("21")
# JUNE
panel_11 = Panel("21")
# DEZEMBER
panel_12 = Panel("21")
analysisperiod = LBAnalysisPeriod(start_month="3", start_day=panel_10, start_hour=0, end_month="3", end_day=panel_10)  # -> period, hoys, dates; plug-in component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
analysisperiod_2 = LBAnalysisPeriod(start_month="9", start_day=panel_9, start_hour=0, end_month="9", end_day=panel_9)  # -> period, hoys, dates; plug-in component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
analysisperiod_3 = LBAnalysisPeriod(start_month="6", start_day=panel_11, start_hour=0, end_month="6", end_day=panel_11)  # -> period, hoys, dates; plug-in component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
analysisperiod_4 = LBAnalysisPeriod(start_month="12", start_day=panel_12, start_hour=0, end_month="12", end_day=panel_12)  # -> period, hoys, dates; plug-in component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
construct_point_7 = ConstructPoint(XCoordinate=Slider(13, range=0..150), YCoordinate=Slider(15, range=0..100), ZCoordinate=0)
construct_point_8 = ConstructPoint(XCoordinate=Slider(13, range=0..150), YCoordinate=Slider(15, range=0..100), ZCoordinate=0)
construct_point_9 = ConstructPoint(XCoordinate=Slider(13, range=0..150), YCoordinate=Slider(15, range=0..100), ZCoordinate=0)
construct_point_10 = ConstructPoint(XCoordinate=Slider(13, range=0..150), YCoordinate=Slider(15, range=0..100), ZCoordinate=0)
sunpath = LBSunPath(
    north=Slider(350, range=0..360),
    location=importepw.location,
    hoys=analysisperiod.hoys,
    center_pt=construct_point_8,
    scale=1,
    data=importepw.dry_bulb_temperature)  # -> out, vectors, altitudes, azimuths, hoys, sun_pts, analemma, daily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; plug-in component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
sunpath_2 = LBSunPath(
    north=Slider(350, range=0..360),
    location=importepw.location,
    hoys=analysisperiod_2.hoys,
    center_pt=construct_point_7,
    scale=1,
    data=importepw.dry_bulb_temperature)  # -> out, vectors, altitudes, azimuths, hoys, sun_pts, analemma, daily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; plug-in component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
sunpath_3 = LBSunPath(
    north=Slider(350, range=0..360),
    location=importepw.location,
    hoys=analysisperiod_3.hoys,
    center_pt=construct_point_9,
    scale=1,
    data=importepw.dry_bulb_temperature)  # -> out, vectors, altitudes, azimuths, hoys, sun_pts, analemma, daily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; plug-in component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
sunpath_4 = LBSunPath(
    north=Slider(350, range=0..360),
    location=importepw.location,
    hoys=analysisperiod_4.hoys,
    center_pt=construct_point_10,
    scale=1,
    data=importepw.dry_bulb_temperature)  # -> out, vectors, altitudes, azimuths, hoys, sun_pts, analemma, daily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; plug-in component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
directsunhours = LBDirectSunHours(
    vectors=flatten(sunpath_3.vectors),
    geometry=flatten(evaluate_surface.Frame),
    context=flatten([geometry_2, geometry]),
    grid_size=Slider(1.5, range=0..100),
    offset_dist=Slider(1, range=0..100),
    run=Toggle(True))  # -> points, results, mesh, legend, title, int_mtx; plug-in component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
directsunhours_2 = LBDirectSunHours(
    vectors=flatten(sunpath_4.vectors),
    geometry=flatten(evaluate_surface.Frame),
    context=flatten([geometry_2, geometry]),
    grid_size=Slider(1.5, range=0..100),
    offset_dist=Slider(1, range=0..100),
    run=Toggle(True))  # -> out, points, results, mesh, legend, title, int_mtx; plug-in component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
directsunhours_3 = LBDirectSunHours(
    vectors=flatten(sunpath.vectors),
    geometry=flatten(evaluate_surface.Frame),
    context=flatten([geometry_2, geometry]),
    grid_size=Slider(1.5, range=0..100),
    offset_dist=Slider(1, range=0..100),
    run=Toggle(True))  # -> out, points, results, mesh, legend, title, int_mtx; plug-in component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
directsunhours_4 = LBDirectSunHours(
    vectors=flatten(sunpath_2.vectors),
    geometry=flatten(evaluate_surface.Frame),
    context=flatten([geometry_2, geometry]),
    grid_size=Slider(1.5, range=0..100),
    offset_dist=Slider(1, range=0..100),
    run=Toggle(True))  # -> out, points, results, mesh, legend, title, int_mtx; plug-in component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
panel_13 = Panel(directsunhours.results)
panel_14 = Panel(directsunhours_2.results)
panel_15 = Panel(directsunhours_3.results)
panel_16 = Panel(directsunhours_4.results)

# ----
point_list = PointList(Points=evaluate_surface.Point, Size=0.3)
# Distance of each point
# to the building in west face
curve_closest_point = CurveClosestPoint(Point=evaluate_surface.Point, Curve=line_2)  # -> Point, Parameter, Distance
# Distance of each point
# to the building in east face
curve_closest_point_2 = CurveClosestPoint(Point=evaluate_surface.Point, Curve=line_3)  # -> Point, Parameter, Distance
# Distance of each point
# to the axis of the street
curve_closest_point_3 = CurveClosestPoint(Point=evaluate_surface.Point, Curve=line)  # -> Point, Parameter, Distance
# Getting X and Y separately
deconstruct_3 = Deconstruct(Point=evaluate_surface.Point)  # -> XComponent, YComponent, ZComponent
panel_17 = Panel(curve_closest_point_3.Distance)

# ---- group: Extracting the information as parameters
py3_2 = Python3Script(llm_json=py3.out_2)  # -> out, room_names, room_areas, room_connections, room_windows, room_solar_orientation, room_noise_level
# ---------- py3_2: Python ----------
import ast

# Step 1: Convert the string to a Python dictionary
llm_dict = ast.literal_eval(llm_json)

# Step 2: Now access the data safely
rooms = llm_dict['rooms']

room_names = []
room_areas = []
room_connections = set()
room_windows = []
room_solar_orientation = []
room_noise_level = []

for room in rooms:
    room_type = room['type']
    room_area = room['area']
    connects_to = room['connects_to']  # Already a list now
    room_window = room['window_counts']
    solar_orientation = room['solar_orientation']
    noise_level = room['noise_level']

    room_names.append(room_type)
    room_areas.append(room_area)
    room_windows.append(room_window)
    room_solar_orientation.append(solar_orientation)
    room_noise_level.append(noise_level)

    for target in connects_to:
        # Avoid duplicates like A-B and B-A by sorting
        pair = tuple(sorted([room_type, target]))
        connection = f"{pair[0]}-{pair[1]}"
        room_connections.add(connection)

# Step 3: Output the results to Grasshopper
room_connections = sorted(room_connections)  # Sorted list of unique connections
# ---------- end py3_2 ----------

# ----
noise_level = Panel(py3_2.room_noise_level)

# ---- group: Noise level classification
# Very noise
# Noise
# Little noise
panel_18 = Panel("12")
smaller_than = SmallerThan(FirstNumber=curve_closest_point_3.Distance, SecondNumber=panel_18)  # -> SmallerThan, OrEqualTo
larger_than = LargerThan(FirstNumber=curve_closest_point_3.Distance, SecondNumber="11")  # -> LargerThan, OrEqualTo
smaller_than_2 = SmallerThan(FirstNumber=curve_closest_point_3.Distance, SecondNumber="22")  # -> SmallerThan, OrEqualTo
larger_than_2 = LargerThan(FirstNumber=curve_closest_point_3.Distance, SecondNumber="21")  # -> LargerThan, OrEqualTo
gate_and = GateAnd(A=larger_than.LargerThan, B=smaller_than_2.SmallerThan)
replace_text = ReplaceText(Text=smaller_than.SmallerThan, Find="True", Replace="Very Noise", RecursiveReplace=False)
replace_text_2 = ReplaceText(Text=gate_and, Find="True", Replace="Noise", RecursiveReplace=False)
replace_text_3 = ReplaceText(Text=larger_than_2.LargerThan, Find="True", Replace="Little Noise", RecursiveReplace=False)
panel_19 = Panel(replace_text_3)
panel_20 = Panel(replace_text_2)
panel_21 = Panel(replace_text)
replace_text_4 = ReplaceText(Text=replace_text_3, Find="False", RecursiveReplace=False)  # -> flatten(Result)
replace_text_5 = ReplaceText(Text=replace_text_2, Find="False", Replace=replace_text_4, RecursiveReplace=False)  # -> flatten(Result)
replace_text_6 = ReplaceText(Text=replace_text, Find="False", Replace=replace_text_5, RecursiveReplace=False)  # -> flatten(Result)
panel_22 = Panel(replace_text_6)

# ---- group: Distance to closest building (West Facade)
# Less than 3 meters
# More than 3 meters
panel_23 = Panel("3")
smaller_than_3 = SmallerThan(FirstNumber=curve_closest_point.Distance, SecondNumber=panel_23)  # -> SmallerThan, OrEqualTo
larger_than_3 = LargerThan(FirstNumber=curve_closest_point.Distance, SecondNumber="3")  # -> LargerThan, OrEqualTo
replace_text_7 = ReplaceText(Text=larger_than_3.LargerThan, Find="True", Replace="> 3m", RecursiveReplace=False)
replace_text_8 = ReplaceText(Text=smaller_than_3.OrEqualTo, Find="True", Replace="< 3m", RecursiveReplace=False)
panel_24 = Panel(replace_text_7)
panel_25 = Panel(replace_text_8)
replace_text_9 = ReplaceText(Text=replace_text_7, Find="False", RecursiveReplace=False)  # -> flatten(Result)
replace_text_10 = ReplaceText(Text=replace_text_8, Find="False", Replace=replace_text_9, RecursiveReplace=False)  # -> flatten(Result)
panel_26 = Panel(replace_text_10)

# ---- group: Distance to closest building (East Facade)
# Less than 3 meters
# More than 3 meters
panel_27 = Panel("3")
smaller_than_4 = SmallerThan(FirstNumber=curve_closest_point_2.Distance, SecondNumber=panel_27)  # -> SmallerThan, OrEqualTo
larger_than_4 = LargerThan(FirstNumber=curve_closest_point_2.Distance, SecondNumber="3")  # -> LargerThan, OrEqualTo
replace_text_11 = ReplaceText(Text=larger_than_4.LargerThan, Find="True", Replace="> 3m", RecursiveReplace=False)
replace_text_12 = ReplaceText(Text=smaller_than_4.SmallerThan, Find="True", Replace="< 3m", RecursiveReplace=False)
panel_28 = Panel(replace_text_11)
panel_29 = Panel(replace_text_12)
replace_text_13 = ReplaceText(Text=replace_text_11, Find="False", RecursiveReplace=False)  # -> flatten(Result)
replace_text_14 = ReplaceText(Text=replace_text_12, Find="False", Replace=replace_text_13, RecursiveReplace=False)  # -> flatten(Result)
panel_30 = Panel(replace_text_14)

# ----
solar_orientation = Panel(py3_2.room_solar_orientation)

# ---- group: Calculating the distante of each point to terrain limits
# North dist.
# South dist.
# East dist.
# West dist.
subtraction = Subtraction(A=panel_4, B=deconstruct_3.YComponent)
subtraction_2 = Subtraction(A=deconstruct_3.YComponent, B=panel_5)
subtraction_3 = Subtraction(A=panel_2, B=deconstruct_3.XComponent)
subtraction_4 = Subtraction(A=deconstruct_3.XComponent, B=panel_3)
panel_31 = Panel(subtraction)
panel_32 = Panel(subtraction_2)
panel_33 = Panel(subtraction_3)
panel_34 = Panel(subtraction_4)

# ----
windows_count = Panel(py3_2.room_windows)
panel_35 = Panel(evaluate_surface.Point)
rooms = Panel(py3_2.room_names)
area_min = Panel(py3_2.room_areas)
connectivity = Panel(py3_2.room_connections)
mass_addition = MassAddition(Input=area_min)  # -> Result, PartialResults

# ---- group: Layout options
parameter = Slider(2.478, range=0..4)

# ----
py3_3 = Python3Script(room_names=rooms, pairs=connectivity)  # -> out, index_pairs; inputs room_names: list, pairs: list
# ---------- py3_3: Python ----------
name_to_index = {name: idx for idx, name in enumerate(room_names)}
print(name_to_index)

index_pairs = []
for pair in pairs:
    room1, room2 = pair.split("-")
    index_pair = str(name_to_index[room1]+1) + "-" + str(name_to_index[room2]+1)
    index_pairs.append(index_pair)
# ---------- end py3_3 ----------
panel_36 = Panel(mass_addition.Result)
evaluate_curve = EvaluateCurve(Curve=rectangle.Rectangle, Parameter=parameter)  # -> Point, Tangent, Angle
panel_37 = Panel(py3_3.index_pairs)
py3_4 = Python3Script(room_names=rooms)  # -> out, a; inputs room_names: list
# ---------- py3_4: Python ----------
a = []
for name in room_names:
    if name == "foyer":
        a.append("True")
    else:
        a.append("False")
# ---------- end py3_4 ----------
houseinstanceadvanced = HouseInstanceAdvanced(
    Boundary=rectangle.Rectangle,
    EntrancePoint=evaluate_curve.Point,
    RoomAreas=area_min,
    RoomNames=rooms,
    IsHall=py3_4.a,
    Adjacency=panel_37,
    RotateBoundary=False)
corridor = ColourSwatch(SwatchColor=RGB(162, 202, 222))
corridor_2 = ColourSwatch(SwatchColor=RGB(222, 126, 147))
laundry = ColourSwatch(SwatchColor=RGB(227, 183, 129))
kitchen = ColourSwatch(SwatchColor=RGB(235, 166, 157))
laundry_2 = ColourSwatch(SwatchColor=RGB(227, 183, 129))
kitchen_2 = ColourSwatch(SwatchColor=RGB(160, 196, 151))
dining = ColourSwatch(SwatchColor=RGB(132, 186, 183))
dining_2 = ColourSwatch(SwatchColor=RGB(160, 196, 151))
bath1 = ColourSwatch(SwatchColor=RGB(157, 165, 191))
bath2 = ColourSwatch(SwatchColor=RGB(145, 137, 201))
office = ColourSwatch(SwatchColor=RGB(222, 126, 147))
living = ColourSwatch(SwatchColor=RGB(252, 134, 119))
bath1_2 = ColourSwatch(SwatchColor=RGB(222, 126, 147))
bath2_2 = ColourSwatch(SwatchColor=RGB(222, 126, 147))
foyer = ColourSwatch(SwatchColor=RGB(242, 157, 225))
toilet = ColourSwatch(SwatchColor=RGB(255, 114, 79))
bed1 = ColourSwatch(SwatchColor=RGB(186, 204, 195))
bed2 = ColourSwatch(SwatchColor=RGB(160, 196, 151))
office_2 = ColourSwatch(SwatchColor=RGB(222, 126, 147))
living_2 = ColourSwatch(SwatchColor=RGB(160, 196, 151))
foyer_2 = ColourSwatch(SwatchColor=RGB(160, 196, 151))
toilet_2 = ColourSwatch(SwatchColor=RGB(160, 196, 151))
bed1_2 = ColourSwatch(SwatchColor=RGB(222, 126, 147))
bed2_2 = ColourSwatch(SwatchColor=RGB(222, 126, 147))

# ---- group: Remember: remove corridors
magnetizingrooms_es = MagnetizingRooms_ES(HouseInstance=houseinstanceadvanced, Iterations="200", MaxAdjDistance=2, CellSizeM=1)  # -> Corridors, RoomBreps, RoomNames, Adjacencies, MissingAdjacences, Boundary, BoundaryOffset

# ----
merge = Merge(
    Data1=foyer,
    Data2=kitchen,
    Data3=laundry,
    Data4=living,
    Data5=toilet,
    Data6=dining,
    Data7=corridor,
    Data8=office,
    Data9=bed1,
    Data10=bath1,
    Data11=bed2,
    Data12=bath2)
merge_2 = Merge(
    Data1=foyer_2,
    Data2=kitchen_2,
    Data3=laundry_2,
    Data4=living_2,
    Data5=toilet_2,
    Data6=dining_2,
    Data7=corridor_2,
    Data8=office_2,
    Data9=bed1_2,
    Data10=bath1_2,
    Data11=bed2_2,
    Data12=bath2_2)
panel_38 = Panel(magnetizingrooms_es.RoomNames)

# ---- group: Realocate the origin to the center of the rectangle
area = Area(Geometry=magnetizingrooms_es.RoomBreps)  # -> Area, Centroid
average = Average(Input=area.Centroid)
vector_2pt = Vector2Pt(PointA=average, PointB="12.5,15,0", Unitize=False)  # -> Vector, Length
move = Move(Geometry=magnetizingrooms_es.RoomBreps, Motion=vector_2pt.Vector)  # -> Geometry, Transform
move_2 = Move(Geometry=magnetizingrooms_es.Corridors, Motion=vector_2pt.Vector)  # -> Geometry, Transform

# ----
concatenate = Concatenate(Fragment_A="Direct sun hours 21 MARCH: ", Fragment_B=directsunhours_3.results, A="h")

# ---- group: Joining info with parameter name
concatenate_2 = Concatenate(Fragment_A="Direct sun hours 21 DEZEMBER: ", Fragment_B=directsunhours_2.results, A="h")
concatenate_3 = Concatenate(Fragment_A="Direct sun hours 21 JUNE: ", Fragment_B=directsunhours.results, A="h")
concatenate_4 = Concatenate(Fragment_A="Direct sun hours 21 SEPTEMBER: ", Fragment_B=directsunhours_4.results, A="h")
concatenate_5 = Concatenate(FragmentA="Coordenates: ", FragmentB=panel_35)
concatenate_6 = Concatenate(Fragment_A="North dist.: ", Fragment_B=panel_31, A="m")
concatenate_7 = Concatenate(Fragment_A="South dist.: ", Fragment_B=panel_32, A="m")
concatenate_8 = Concatenate(Fragment_A="East dist.: ", Fragment_B=panel_33, A="m")
concatenate_9 = Concatenate(Fragment_A="West dist.: ", Fragment_B=panel_34, A="m")
concatenate_10 = Concatenate(Fragment_A="Street axis dist.: ", Fragment_B=curve_closest_point_3.Distance, A="m")
concatenate_11 = Concatenate(FragmentA="Noise level: ", FragmentB=replace_text_6)
concatenate_12 = Concatenate(FragmentA="Dist. closest building (West Facade): ", FragmentB=replace_text_10)
concatenate_13 = Concatenate(FragmentA="Dist. closest building (East Facade): ", FragmentB=replace_text_14)
entwine = Entwine(
    Branch00=concatenate_5,
    Branch01=concatenate_6,
    Branch02=concatenate_7,
    Branch03=concatenate_8,
    Branch04=concatenate_9,
    Branch05=concatenate_10,
    Branch06=concatenate_11,
    Branch07=concatenate_12,
    Branch08=concatenate_13,
    Branch09=concatenate,
    Branch010=concatenate_3,
    Branch011=concatenate_4,
    Branch012=concatenate_2,
    FlattenInputs=True)  # -> simplify(Result)

# ---- group: Name legend
py3_5 = Python3Script(room_names=magnetizingrooms_es.RoomNames)  # -> out, clean_names; inputs room_names: list
# ---------- py3_5: Python ----------
clean_names = []
for name in room_names:
    if "&&HALL&&" in name:
        clean_name = name.replace("&&HALL&&", "")  # Remove "&&HALL&&"
        clean_names.append(clean_name)
    else:
        clean_names.append(name)
# ---------- end py3_5 ----------
brep = Brep(move.Geometry)
area_2 = Area(Geometry=brep)  # -> Area, Centroid
justified_text = JustifiedText3d(
    Location=area_2.Centroid,
    Text=py3_5.clean_names,
    Size=Slider(0.265, range=0..1),
    Color=ColourSwatch(SwatchColor=RGB(0, 0, 0)),
    HorizontalAlignment=1,
    VerticalAlginment=1,
    Font="Verdana",
    UseMeshes=False,
    Bake=False)

# ----
py3_6 = Python3Script(room_names=rooms, placed_room_names=py3_5.clean_names)  # -> out, error; inputs room_names: list, placed_room_names: list
# ---------- py3_6: Python ----------
error = False
for name in room_names:
    if name not in placed_room_names:
        error = True
        break
# ---------- end py3_6 ----------

# ---- group: Erro checking
py3_7 = Python3Script(room_names=rooms, placed_room_names=py3_5.clean_names)  # -> out, error; inputs room_names: list, placed_room_names: list; same code as py3_6
panel_39 = Panel(py3_7.error)
py3_8 = Python3Script(room_names=rooms, room_colors=merge, placed_room_names=py3_5.clean_names, error=panel_39)  # -> out, ordered_colors; inputs room_names: list, room_colors: list, placed_room_names: list
# ---------- py3_8: Python ----------
if error == "True":
    ordered_colors = "139,0,0"
    print("dfd")
    
else:
    name_to_color = dict(zip(room_names, room_colors))
    ordered_colors = [name_to_color[name] for name in placed_room_names]
# ---------- end py3_8 ----------

# ----
panel_40 = Panel(py3_6.error)
panel_41 = Panel(entwine)
py3_9 = Python3Script(room_names=rooms, room_colors=merge_2, placed_room_names=py3_5.clean_names, error=panel_40)  # -> out, ordered_colors; inputs room_names: list, room_colors: list, placed_room_names: list; same code as py3_8

# ---- group: Rooms coloring
mesh = Mesh(move.Geometry)
mesh_edges = MeshEdges(Mesh=mesh)  # -> NakedEdges, InteriorEdges, NonManifoldEdges
join_curves = JoinCurves(Curves=mesh_edges.NakedEdges, Preserve=False)  # -> simplify(Curves)
data = Data(flatten(join_curves))
boundary_surfaces_2 = BoundarySurfaces(Edges=data)  # -> flatten(Surfaces)
preview = CustomPreview(Geometry=boundary_surfaces_2, Material=py3_8.ordered_colors)

# ----
flip_matrix = FlipMatrix(Data=panel_41)
panel_42 = Panel(py3_5.clean_names)
panel_43 = Panel(flip_matrix)

# ---- group: Getting the rooms boundaries
curve = Curve(flatten(join_curves))
discontinuity = Discontinuity(Curve=curve, Level=1)  # -> Points, Parameters
curve_closest_point_4 = CurveClosestPoint(Point=flatten(discontinuity.Points), Curve=graft(curve))  # -> Point, Parameter, Distance
boolean = Boolean(curve_closest_point_4.Distance)
dispatch = Dispatch(List=curve_closest_point_4.Parameter, DispatchPattern=boolean)  # -> ListA, ListB
shatter = Shatter(Curve=graft(curve), Parameters=dispatch.ListB)

# ---- group: Room pairs by adjacency
list_length = ListLength(List=move.Geometry)
series = Series(Start=0, Step=1, Count=list_length)
py3_10 = Python3Script(room_names=rooms, room_indices=series, placed_room_names=py3_5.clean_names)  # -> out, reordered_indices; inputs room_names: list, room_indices: list, placed_room_names: list
# ---------- py3_10: Python ----------
placed_name_to_index = {name: i for i, name in enumerate(placed_room_names)}
reordered_indices = [placed_name_to_index[name] for name in room_names]
# ---------- end py3_10 ----------
text_split = TextSplit(Text=panel_37, Separators="-")
list_item = ListItem(List=move.Geometry, Index=py3_10.reordered_indices, Wrap=True)
subtraction_5 = Subtraction(A=text_split, B="1")
list_item_2 = ListItem(List=list_item, Index=subtraction_5, Wrap=True)

# ----
area_3 = Area(Geometry=list_item_2)  # -> Area, Centroid
split_list = SplitList(List=simplify(area_3.Centroid), Index="1")  # -> simplify(ListA), simplify(ListB)
# Floor Plan Graph
panel_44 = Panel("0,-15,0")
vector_2pt_2 = Vector2Pt(PointA="0,15,0", PointB="0,-15,0", Unitize=False)  # -> Vector, Length
circle = Circle(Plane=area_2.Centroid, Radius=Slider(0.6, range=0..10))  # -> simplify(Circle)
vector_2pt_3 = Vector2Pt(PointA="0,14,0", PointB=panel_44, Unitize=False)  # -> Vector, Length
line_4 = Line(StartPoint=split_list.ListA, EndPoint=split_list.ListB)
move_3 = Move(Geometry=circle, Motion=vector_2pt_3.Vector)  # -> Geometry, Transform
move_4 = Move(Geometry=circle, Motion=vector_2pt_2.Vector)  # -> Geometry, Transform
move_5 = Move(Geometry=line_4, Motion=vector_2pt_2.Vector)  # -> Geometry, Transform
area_4 = Area(Geometry=move_3.Geometry)  # -> Area, Centroid
boundary_surfaces_3 = BoundarySurfaces(Edges=move_4.Geometry)
custom_preview_2 = CustomPreview(Geometry=boundary_surfaces_3, Material=py3_9.ordered_colors)
justified_text_2 = JustifiedText3d(
    Location=area_4.Centroid,
    Text=py3_5.clean_names,
    Size=Slider(0.265, range=0..1),
    Color=ColourSwatch(SwatchColor=RGB(0, 0, 0)),
    HorizontalAlignment=1,
    VerticalAlginment=1,
    Font="Verdana",
    UseMeshes=False,
    Bake=False)
custom_preview_lineweights = CustomPreviewLineweights(
    Geometry=flatten(move_5.Geometry),
    Shader=ColourSwatch(SwatchColor=RGB(0, 0, 0)),
    Thickness=Slider(0.05, range=0..10),
    Absolute="True")

# ---- group: Corridors coloring
preview_2 = CustomPreview(Geometry=move_2.Geometry, Material=ColourSwatch(SwatchColor=RGB(255, 255, 255)))

# ---- group: Room coloring - zone
preview_3 = CustomPreview(Geometry=boundary_surfaces_2, Material=py3_9.ordered_colors)

# ----
panel_46 = Panel(py3_5.clean_names)

# ----
# Area info
number_slider = Slider(-0.4, range=-1..1)
area_5 = Area(Geometry=join_curves)  # -> flatten(Area), Centroid
unit_y_2 = UnitY(Factor=1)
brep_2 = Brep(move.Geometry)
area_6 = Area(Geometry=brep_2)  # -> Area, Centroid
format = Format(Format="{0:0.00}", Culture=127, Data0=area_5.Area)
amplitude = Amplitude(Vector=unit_y_2, Amplitude=number_slider)
move_6 = Move(Geometry=area_6.Centroid, Motion=amplitude)  # -> Geometry, Transform
concat = Concatenate(FragmentD=format, FragmentE="m²")
mass_addition_2 = MassAddition(Input=format)  # -> Result, PartialResults
concat_2 = Concatenate(FragmentA="The ", FragmentB=panel_46, FragmentC=" has ", FragmentD=format, FragmentE="m².")
justified_text_3 = JustifiedText3d(
    Location=move_6.Geometry,
    Text=concat,
    Size=Slider(0.172, range=0..1),
    Color=ColourSwatch(SwatchColor=RGB(0, 0, 0)),
    HorizontalAlignment=1,
    VerticalAlginment=1,
    Font="Verdana",
    UseMeshes=False,
    Bake=False)
panel_47 = Panel(mass_addition_2.Result)
panel_48 = Panel(concat_2)

panel_49 = Panel(py3_10.reordered_indices)
panel_50 = Panel(text_split)

# ----
# Doors
panel_51 = Panel("1")
split_list_2 = SplitList(List=list_item_2, Index=panel_51)  # -> ListA, ListB
curve_curve = CurveCurve(CurveA=split_list_2.ListA, CurveB=split_list_2.ListB)  # -> Points, ParamsA, ParamsB
door_wdith = Slider(0.8, range=0..1.2)
average_2 = Average(Input=curve_curve.Points)  # -> simplify(ArithmeticMean)
circle_2 = Circle(Plane=average_2, Radius=expr("x/2", door_wdith))  # -> simplify(Circle)
list_item_3 = ListItem(List=list_item_2, Index=0, Wrap=True)
curve_curve_2 = CurveCurve(CurveA=list_item_3, CurveB=circle_2)  # -> Points, ParamsA, ParamsB
split_list_3 = SplitList(List=curve_curve_2.Points, Index="1")  # -> ListA, ListB
line_5 = Line(StartPoint=split_list_3.ListA, EndPoint=split_list_3.ListB)
end_points = EndPoints(Curve=graft(line_5))  # -> Start, End
length = Length(Curve=graft(line_5))
perp_frame = PerpFrame(Curve=graft(line_5), Parameter="0")
data_2 = Data(reverse(end_points.End))
deconstruct_plane = DeconstructPlane(Plane=perp_frame)  # -> Origin, XAxis, YAxis, ZAxis
reverse = Reverse(Vector=deconstruct_plane.YAxis)
line_sdl = LineSDL(Start=deconstruct_plane.Origin, Direction=reverse, Length=length)
circle_3 = Circle(Plane=deconstruct_plane.Origin, Radius=length)
end_points_2 = EndPoints(Curve=line_sdl)  # -> Start, End
data_3 = Data(end_points_2.End)
merge_3 = Merge(Data1=data_3, Data2=data_2)
curve_closest_point_5 = CurveClosestPoint(Point=merge_3, Curve=circle_3)  # -> Point, Parameter, Distance
shatter_2 = Shatter(Curve=circle_3, Parameters=curve_closest_point_5.Parameter)
length_2 = Length(Curve=shatter_2)
sort_list = SortList(Keys=length_2, ValuesValuesA=shatter_2)  # -> Keys, ValuesValuesA
list_item_4 = ListItem(List=sort_list.ValuesValuesA, Index=0, Wrap=True)
merge_4 = Merge(Data1=line_sdl, Data2=list_item_4, Data3=line_5)
data_4 = Data(merge_4)

# ----
# Interior Walls
curve_middle = CurveMiddle(Curve=shatter)
cull_duplicates = CullDuplicates(Points=curve_middle, Tolerance=0.1, CullMode=3)  # -> Points, Indices, Valence
pull_point = PullPoint(Point=cull_duplicates.Points, Geometry=flatten(average_2), ClosestOnly=True)  # -> ClosestPoint, Distance, Index
smaller_than_5 = SmallerThan(FirstNumber=pull_point.Distance, SecondNumber="0.01")  # -> simplify(SmallerThan), OrEqualTo
dispatch_2 = Dispatch(List=cull_duplicates.Points, DispatchPattern=smaller_than_5.SmallerThan)  # -> ListA, ListB
data_5 = Data(simplify(dispatch_2.ListA))
dispatch_3 = Dispatch(List=shatter, DispatchPattern=smaller_than_5.SmallerThan)  # -> ListA, ListB
data_6 = Data(simplify(dispatch_3.ListA))
circle_4 = Circle(Plane=data_5, Radius=expr("x/2", door_wdith))
curve_curve_3 = CurveCurve(CurveA=data_6, CurveB=circle_4)  # -> Points, ParamsA, ParamsB
trim_tree = TrimTree(Tree=curve_curve_3.ParamsA, Depth=1)
cull_duplicates_2 = CullDuplicates(Points=flatten(data_5), Tolerance=0.1, CullMode=3)  # -> Points, Indices, Valence
shatter_3 = Shatter(Curve=data_6, Parameters=trim_tree)
trim_tree_2 = TrimTree(Tree=shatter_3, Depth=1)
flatten_tree = FlattenTree(Tree=trim_tree_2, Path="{0}")
pull_point_2 = PullPoint(Point=cull_duplicates_2.Points, Geometry=graft(flatten_tree), ClosestOnly=True)  # -> ClosestPoint, Distance, Index
mass_multiplication = MassMultiplication(Input=pull_point_2.Distance)  # -> Result, PartialResults
smaller_than_6 = SmallerThan(FirstNumber=mass_multiplication.Result, SecondNumber="0.01")  # -> SmallerThan, OrEqualTo
dispatch_4 = Dispatch(List=flatten_tree, DispatchPattern=flatten(smaller_than_6.SmallerThan))  # -> ListA, ListB

# ---- group: Min and max area in order
python_3_script = Python3Script(layout_amb=panel_46)  # -> out, areas_max, areas_min; inputs layout_amb: list
# ---------- python_3_script: Python ----------
# Listas originais fixas (você pode ajustar aqui, se quiser)
nomes_ambientes = [
    "foyer", "livingroom", "diningroom", "kitchen",
    "laundry", "toilet", "corridor", "office",
    "bedroom1", "bathroom1", "bedroom2", "bathroom2"
]

areas_min = [2, 10, 8, 6, 3, 2, 5, 6, 9, 4, 7, 4]
areas_max = [4, 22, 15, 10, 6, 3, 10, 10, 12, 6, 9, 6]

# Aqui começa o código que usa a entrada layout_ambientes
areas_min_associadas = []
areas_max_associadas = []

for amb in layout_amb:
    if amb in nomes_ambientes:
        idx = nomes_ambientes.index(amb)
        areas_min_associadas.append(areas_min[idx])
        areas_max_associadas.append(areas_max[idx])
    else:
        # Se o nome do ambiente não estiver na lista original,
        # adiciona None ou um valor padrão (exemplo: 0)
        areas_min_associadas.append(None)
        areas_max_associadas.append(None)

# Saídas para o Grasshopper
areas_min = areas_min_associadas
areas_max = areas_max_associadas
# ---------- end python_3_script ----------

# ----
rooms_final_area = Panel(format)
panel_52 = Panel(panel_46)
smaller_than_7 = SmallerThan(FirstNumber=rooms_final_area, SecondNumber=python_3_script.areas_max)  # -> SmallerThan, OrEqualTo
larger_than_5 = LargerThan(FirstNumber=rooms_final_area, SecondNumber=python_3_script.areas_min)  # -> LargerThan, OrEqualTo
area_max = Panel(python_3_script.areas_max)
area_min_2 = Panel(python_3_script.areas_min)
gate_and_2 = GateAnd(A=larger_than_5.LargerThan, B=smaller_than_7.SmallerThan)
panel_53 = Panel(gate_and_2)

data_7 = Data(boundary_surfaces_2)
python_3_script_2 = Python3Script(layout_amb=panel_46)  # -> out, simplify(windows), simplify(has_window)
# ---------- python_3_script_2: Python ----------
names_amb = [
    "foyer", "livingroom", "diningroom", "kitchen",
    "laundry", "toilet", "corridor", "office",
    "bedroom1", "bathroom1", "bedroom2", "bathroom2"
]

windows = [0, 1, 0, 1, 1, 0, 0, 1, 1, 0, 1, 0]

windows_ass = []

for amb in layout_amb:
    if amb in names_amb:
        idx = names_amb.index(amb)
        windows_ass.append(int(windows[idx]))
    else:
        windows_ass.append(None)  # ou 0

# Resultado booleano: True se tem janela (>0), False se não tem
has_window = [(w > 0) if isinstance(w, int) else False for w in windows_ass]

# Saída no Grasshopper:
# windows_ass -> número de janelas por ambiente
# has_window -> presença de janela (True/False)
# ---------- end python_3_script_2 ----------
panel_54 = Panel(python_3_script_2.has_window)

# ---- group: Walls without doors
data_8 = Data(dispatch_4.ListB)

# ---- group: Doors
data_9 = Data(line_5)

# ----
# Windows
data_10 = Data(flatten(join_curves))
deconstruct_brep = DeconstructBrep(Brep=data_10)  # -> Faces, Edges, Vertices
region_union = RegionUnion(Curves=data_10)
data_11 = Data(deconstruct_brep.Vertices)
data_12 = Data(region_union)
pull_point_3 = PullPoint(Point=data_11, Geometry=region_union, ClosestOnly=True)  # -> ClosestPoint, Distance, Index
deconstruct_brep_2 = DeconstructBrep(Brep=data_12)  # -> Faces, Edges, Vertices
boolean_2 = Boolean(pull_point_3.Distance)
data_13 = Data(deconstruct_brep_2.Vertices)
dispatch_5 = Dispatch(List=data_11, DispatchPattern=boolean_2)  # -> ListA, ListB
data_14 = Data(dispatch_5.ListB)
merge_5 = Merge(Data1=data_13, Data2=data_14)  # -> flatten(Result)
curve_closest_point_6 = CurveClosestPoint(Point=merge_5, Curve=region_union)  # -> Point, Parameter, Distance
shatter_4 = Shatter(Curve=region_union, Parameters=curve_closest_point_6.Parameter)
curve_middle_2 = CurveMiddle(Curve=shatter_4)
pull_point_4 = PullPoint(Point=curve_middle_2, Geometry=join_curves, ClosestOnly=True)  # -> ClosestPoint, Distance, Index
boolean_3 = Boolean(invert(pull_point_4.Distance))
dispatch_multiple = DispatchMultiple(DispatchPattern=boolean_3, ListList0=shatter_4)
dispatch_multiple_2 = DispatchMultiple(DispatchPattern=boolean_3, ListList0=curve_middle_2)
length_3 = Length(Curve=dispatch_multiple)
sort_list_2 = SortList(Keys=length_3, ValuesValuesA=dispatch_multiple_2)  # -> Keys, reverse(ValuesValuesA)
sort_list_3 = SortList(Keys=length_3, ValuesValuesA=dispatch_multiple)  # -> Keys, reverse(ValuesValuesA)
panel_55 = Panel("""0
1""")
list_item_5 = ListItem(List=sort_list_2.ValuesValuesA, Index=panel_55, Wrap=True)
length_4 = Length(Curve=sort_list_3.ValuesValuesA)
smaller_than_8 = SmallerThan(FirstNumber=length_4, SecondNumber=expr("x*2", "0.8"))  # -> SmallerThan, OrEqualTo
dispatch_6 = Dispatch(List=list_item_5, DispatchPattern=smaller_than_8.SmallerThan)  # -> ListA, ListB

data_15 = Data(simplify(dispatch_3.ListB))
curve_middle_3 = CurveMiddle(Curve=data_15)
pull_point_5 = PullPoint(Point=flatten(curve_middle_3), Geometry=region_union, ClosestOnly=True)  # -> ClosestPoint, Distance, Index
boolean_4 = Boolean(pull_point_5.Distance)
dispatch_7 = Dispatch(List=flatten(data_15), DispatchPattern=boolean_4)  # -> ListA, ListB
data_16 = Data(dispatch_7.ListA)
merge_6 = Merge(Data1=data_8, Data2=data_16)  # -> flatten(Result)

# ---- group: Windows location
data_17 = Data(dispatch_6.ListB)

# ----
circle_5 = Circle(Plane=data_17, Radius="0.8")
curve_curve_4 = CurveCurve(CurveA=circle_5, CurveB=join_curves)  # -> simplify(Points), ParamsA, ParamsB
split_list_4 = SplitList(List=curve_curve_4.Points, Index="1")  # -> ListA, ListB
line_6 = Line(StartPoint=split_list_4.ListA, EndPoint=split_list_4.ListB)

panel_56 = Panel(dispatch_6.ListB)

list_length_2 = ListLength(List=data_17)  # -> flatten(Length)
concat_3 = Concatenate(FragmentA="The ", FragmentB=panel_46, FragmentC=" has ", FragmentD=list_length_2, FragmentE=" windows.")
panel_57 = Panel(concat_3)

curve_curve_5 = CurveCurve(CurveA=flatten(line_6), CurveB=region_union)  # -> Points, ParamsA, ParamsB
curve_closest_point_7 = CurveClosestPoint(Point=curve_curve_5.Points, Curve=region_union)  # -> Point, Parameter, Distance
shatter_5 = Shatter(Curve=region_union, Parameters=flatten(curve_closest_point_7.Parameter))
curve_middle_4 = CurveMiddle(Curve=shatter_5)
pull_point_6 = PullPoint(Point=curve_middle_4, Geometry=flatten(line_6), ClosestOnly=True)  # -> ClosestPoint, Distance, Index
boolean_5 = Boolean(pull_point_6.Distance)
dispatch_8 = Dispatch(List=shatter_5, DispatchPattern=boolean_5)  # -> ListA, ListB

# ---- group: Interior walls representation
custom_preview_lineweights_2 = CustomPreviewLineweights(
    Geometry=flatten(merge_6),
    Shader=ColourSwatch(SwatchColor=RGB(0, 0, 0)),
    Thickness=Slider(0.1, range=0..10),
    Absolute="True")

# ---- group: Walls without windows
data_18 = Data(dispatch_8.ListA)

# ---- group: Exterior walls representation
custom_preview_lineweights_3 = CustomPreviewLineweights(
    Geometry=flatten(data_18),
    Shader=ColourSwatch(SwatchColor=RGB(0, 0, 0)),
    Thickness=Slider(0.2, range=0..10),
    Absolute="True")

# ---- group: External Walls
data_19 = Data(dispatch_7.ListB)

# ---- group: Interior Walls
data_20 = Data([data_6, data_16])

# ----
panel_58 = Panel(py3_5.clean_names)
trim_tree_3 = TrimTree(Tree=line_6, Depth=1)
trim_tree_4 = TrimTree(Tree=trim_tree_3, Depth=1)
evaluate = Evaluate(Expression="x<>\"foyer\"", x=graft(panel_58))
removeduplicatelines = RemoveDuplicateLines(Lines=trim_tree_4, Tolerance=0.01)  # -> simplify(UniqueLines)
boolean_6 = Boolean(invert(flatten(evaluate)))
tree_statistics = TreeStatistics(Tree=removeduplicatelines)  # -> Paths, Length, Count
dispatch_9 = Dispatch(List=tree_statistics.Paths, DispatchPattern=boolean_6)  # -> ListA, ListB
tree_branch = TreeBranch(Tree=removeduplicatelines, Path=dispatch_9.ListB, MaintainPaths=True)
tree_branch_2 = TreeBranch(Tree=removeduplicatelines, Path=dispatch_9.ListA, MaintainPaths=True)

# ---- group: Entrance door
data_21 = Data(tree_branch_2)

# ---- group: Windows
data_22 = Data(tree_branch)

# ---- group: Window representation
custom_preview_lineweights_4 = CustomPreviewLineweights(
    Geometry=flatten(data_22),
    Shader=ColourSwatch(SwatchColor=RGB(0, 0, 0)),
    Thickness=Slider(0.07, range=0..10),
    Absolute="True")

# ---- group: Entrance door
data_23 = Data(data_21)

# ---- group: Windows
data_24 = Data(data_22)

# ----
end_points_3 = EndPoints(Curve=graft(data_21))  # -> Start, End
length_5 = Length(Curve=graft(data_21))
perp_frame_2 = PerpFrame(Curve=graft(data_21), Parameter="0")
data_25 = Data(end_points_3.End)
deconstruct_plane_2 = DeconstructPlane(Plane=perp_frame_2)  # -> Origin, XAxis, YAxis, ZAxis
reverse_2 = Reverse(Vector=deconstruct_plane_2.YAxis)
line_sdl_2 = LineSDL(Start=deconstruct_plane_2.Origin, Direction=reverse_2, Length=length_5)
circle_6 = Circle(Plane=deconstruct_plane_2.Origin, Radius=length_5)
end_points_4 = EndPoints(Curve=line_sdl_2)  # -> Start, End
data_26 = Data(end_points_4.End)
merge_7 = Merge(Data1=data_26, Data2=data_25)
curve_closest_point_8 = CurveClosestPoint(Point=merge_7, Curve=circle_6)  # -> Point, Parameter, Distance
shatter_6 = Shatter(Curve=circle_6, Parameters=curve_closest_point_8.Parameter)
length_6 = Length(Curve=shatter_6)
sort_list_4 = SortList(Keys=length_6, ValuesValuesA=shatter_6)  # -> Keys, ValuesValuesA
list_item_6 = ListItem(List=sort_list_4.ValuesValuesA, Index=0, Wrap=True)
merge_8 = Merge(Data1=line_sdl_2, Data2=list_item_6, Data3=data_21)
data_27 = Data(merge_8)

# ---- group: Doors representation
custom_preview_lineweights_5 = CustomPreviewLineweights(
    Geometry=flatten([data_4, data_27]),
    Shader=ColourSwatch(SwatchColor=RGB(0, 0, 0)),
    Thickness=Slider(0.05, range=0..10),
    Absolute="True")

# ----
data_28 = Data(end_points_3.Start)

# ----
# 3D Visualization
wall = Slider(0.2, range=0..1)
height = Slider(3, range=0..3)
join_curves_2 = JoinCurves(Curves=data_19, Preserve=False)
data_29 = Data([data_9, data_23])
unit_z = UnitZ(Factor=height)
division = Division(A=wall, B=3)
division_2 = Division(A=wall, B=2)
division_3 = Division(A=wall, B="2")
negative = Negative(Value=division_3)
move_7 = Move(Geometry=join_curves_2, Motion=unit_z)  # -> Geometry, Transform
division_4 = Division(A=wall, B="2")
addition = Addition(A=division, B=division_2)
negative_2 = Negative(Value=division_4)
negative_3 = Negative(Value=addition)
offset_curve = OffsetCurve(Curve=join_curves_2, Distance=division_3, Corners=1)
offset_curve_2 = OffsetCurve(Curve=join_curves_2, Distance=negative, Corners=1)
offset_curve_3 = OffsetCurve(Curve=data_20, Distance=division_4, Corners=1)
offset_curve_4 = OffsetCurve(Curve=data_20, Distance=negative_2, Corners=1)
offset_curve_5 = OffsetCurve(Curve=data_29, Distance=addition, Corners=1)
offset_curve_6 = OffsetCurve(Curve=data_29, Distance=negative_3, Corners=1)
floor_tickness = Slider(0.2, range=0..3)
floor_tickness_2 = Slider(0.2, range=0..3)
addition_2 = Addition(A=division, B=division_2)
graft_tree = GraftTree(Tree=offset_curve, IncludeEmptyLists=True, IncludeNullItems=True)
graft_tree_2 = GraftTree(Tree=offset_curve_2, IncludeEmptyLists=True, IncludeNullItems=True)
graft_tree_3 = GraftTree(Tree=offset_curve_3, IncludeEmptyLists=True, IncludeNullItems=True)
graft_tree_4 = GraftTree(Tree=offset_curve_4, IncludeEmptyLists=True, IncludeNullItems=True)
graft_tree_5 = GraftTree(Tree=offset_curve_5, IncludeEmptyLists=True, IncludeNullItems=True)
graft_tree_6 = GraftTree(Tree=offset_curve_6, IncludeEmptyLists=True, IncludeNullItems=True)
door_height = Slider(2.1, range=0..3)
unit_z_2 = UnitZ(Factor=floor_tickness)
loft = Loft(
    Curves=[graft_tree, graft_tree_2],
    Options={Adjust=False, Closed=False, LoftEnds=0, LoftSimp=0, LoftType=0, Rebuild=10, Refit=0.01})
loft_2 = Loft(
    Curves=[graft_tree_3, graft_tree_4],
    Options={Adjust=False, Closed=False, LoftEnds=0, LoftSimp=0, LoftType=0, Rebuild=10, Refit=0.01})
loft_3 = Loft(
    Curves=[graft_tree_5, graft_tree_6],
    Options={Adjust=False, Closed=False, LoftEnds=0, LoftSimp=0, LoftType=0, Rebuild=10, Refit=0.01})
unit_z_3 = UnitZ(Factor=door_height)
unit_z_4 = UnitZ(Factor=door_height)
unit_z_5 = UnitZ(Factor=floor_tickness_2)
unit_z_6 = UnitZ(Factor=Slider(3, range=0..10))
negative_4 = Negative(Value=unit_z_2)
merge_faces = MergeFaces(Brep=loft_2)  # -> Breps, Before, After
move_8 = Move(Geometry=data_24, Motion=unit_z_3)  # -> Geometry, Transform
merge_faces_2 = MergeFaces(Brep=loft)  # -> Breps, Before, After
extrude = Extrude(Base=loft_3, Direction=unit_z_4)  # -> flatten(Extrusion)
offset_curve_7 = OffsetCurve(Curve=move_8.Geometry, Distance=addition_2, Corners=1)
offset_curve_8 = OffsetCurve(Curve=move_8.Geometry, Distance=negative_3, Corners=1)
window_height = Slider(2, range=0..3)
region_union_2 = RegionUnion(Curves=flatten(merge_faces.Breps))
graft_tree_7 = GraftTree(Tree=offset_curve_7, IncludeEmptyLists=True, IncludeNullItems=True)
graft_tree_8 = GraftTree(Tree=offset_curve_8, IncludeEmptyLists=True, IncludeNullItems=True)
boundary_surfaces_4 = BoundarySurfaces(Edges=region_union_2)
unit_z_7 = UnitZ(Factor=window_height)
loft_4 = Loft(
    Curves=[graft_tree_7, graft_tree_8],
    Options={Adjust=False, Closed=False, LoftEnds=0, LoftSimp=0, LoftType=0, Rebuild=10, Refit=0.01})
extrude_2 = Extrude(Base=merge_faces_2.Breps, Direction=unit_z_6)
extrude_3 = Extrude(Base=boundary_surfaces_4, Direction=unit_z_6)
negative_5 = Negative(Value=unit_z_7)
solid_difference = SolidDifference(BrepsA=flatten(extrude_3), BrepsB=extrude_2)
extrude_4 = Extrude(Base=loft_4, Direction=negative_5)  # -> flatten(Extrusion)
relay = Relay([extrude_2, solid_difference])
solid_difference_2 = SolidDifference(BrepsA=extrude_2, BrepsB=flatten([extrude, extrude_4]))
solid_difference_3 = SolidDifference(BrepsA=solid_difference, BrepsB=extrude)

# ---- group: Roof
offset_curve_9 = OffsetCurve(Curve=move_7.Geometry, Distance=division_3, Corners=1)

# ---- group: Floor
offset_curve_10 = OffsetCurve(Curve=join_curves_2, Distance=division_3, Corners=1)

# ----
boundary_surfaces_5 = BoundarySurfaces(Edges=offset_curve_10)

boundary_surfaces_6 = BoundarySurfaces(Edges=offset_curve_9)
extrude_5 = Extrude(Base=boundary_surfaces_6, Direction=unit_z_5)
extrude_6 = Extrude(Base=boundary_surfaces_5, Direction=negative_4)

# ----
# 3D Representation
door_window_tickness = Slider(0.05, range=0..1)
division_5 = Division(A=door_window_tickness, B=2)
negative_6 = Negative(Value=division_5)
window_height_2 = Slider(1.2, range=0..3)
offset_curve_11 = OffsetCurve(Curve=data_29, Distance=division_5, Corners=1)
offset_curve_12 = OffsetCurve(Curve=data_29, Distance=negative_6, Corners=1)
offset_curve_13 = OffsetCurve(Curve=move_8.Geometry, Distance=division_5, Corners=1)
offset_curve_14 = OffsetCurve(Curve=move_8.Geometry, Distance=negative_6, Corners=1)
graft_tree_9 = GraftTree(Tree=offset_curve_11, IncludeEmptyLists=True, IncludeNullItems=True)
graft_tree_10 = GraftTree(Tree=offset_curve_12, IncludeEmptyLists=True, IncludeNullItems=True)
graft_tree_11 = GraftTree(Tree=offset_curve_13, IncludeEmptyLists=True, IncludeNullItems=True)
graft_tree_12 = GraftTree(Tree=offset_curve_14, IncludeEmptyLists=True, IncludeNullItems=True)
unit_z_8 = UnitZ(Factor=window_height_2)
door_height_2 = Slider(2.1, range=0..3)
loft_5 = Loft(
    Curves=[graft_tree_9, graft_tree_10],
    Options={Adjust=False, Closed=False, LoftEnds=0, LoftSimp=0, LoftType=0, Rebuild=10, Refit=0.01})
loft_6 = Loft(
    Curves=[graft_tree_11, graft_tree_12],
    Options={Adjust=False, Closed=False, LoftEnds=0, LoftSimp=0, LoftType=0, Rebuild=10, Refit=0.01})
negative_7 = Negative(Value=unit_z_8)
unit_z_9 = UnitZ(Factor=door_height_2)
extrude_7 = Extrude(Base=loft_5, Direction=unit_z_9)  # -> flatten(Extrusion)
extrude_8 = Extrude(Base=loft_6, Direction=negative_7)
solid_intersection = SolidIntersection(BrepsA=extrude_2, BrepsB=flatten(extrude_8))
solid_intersection_2 = SolidIntersection(BrepsA=relay, BrepsB=graft(extrude_7))
rotate = Rotate(Geometry=solid_intersection_2, Angle=Slider(1.55, range=0..2), Plane=[deconstruct_plane.Origin, data_28])  # -> Geometry, Transform

# ---- group: Roof - 3D
preview_4 = CustomPreview(Geometry=extrude_5, Material=ColourSwatch(SwatchColor=RGB(204, 204, 204)))

# ---- group: Walls - 3D
preview_5 = CustomPreview(Geometry=[solid_difference_2, solid_difference_3], Material=ColourSwatch(SwatchColor=RGB(204, 204, 204)))

# ---- group: Floor - 3D
preview_6 = CustomPreview(Geometry=extrude_6, Material=ColourSwatch(SwatchColor=RGB(204, 204, 204)))

# ---- group: Windows - 3D
create_material = CreateMaterial(
    Diffuse=ColourSwatch(SwatchColor=RGB(159, 182, 189)),
    Specular=RGB(255, 255, 255),
    Emission=RGB(0, 0, 0),
    Transparency=Slider(0.42, range=0..1),
    Shine=0)
preview_7 = CustomPreview(Geometry=solid_intersection, Material=create_material)

# ---- group: Doors - 3D
preview_8 = CustomPreview(Geometry=rotate.Geometry, Material=ColourSwatch(SwatchColor=RGB(145, 129, 93)))
